# Dynamo graph Brace Export.dyn (Dynamo 2.19.3.6394)

python_script = Python()  # CPython3; unwired: IN[0]
# ---------- python_script.python (146 lines) ----------
# -*- coding: utf-8 -*-
# Dynamo CPython3 for Revit 2024+
# HS/HSS (square) braces -> one CSV:
# story, section, direction, min_length, max_length
# Direction is taken from the brace's own plan major axis (no beam association).

import clr, sys, os, re, math, csv, datetime as _dt
clr.AddReference('RevitAPI'); clr.AddReference('RevitServices')
from Autodesk.Revit.DB import (
    FilteredElementCollector, BuiltInCategory, BuiltInParameter,
    Level, Line, XYZ
)
from RevitServices.Persistence import DocumentManager
doc = DocumentManager.Instance.CurrentDBDocument


OUT_DIR  = r"C:\Users\Levi\Desktop\Final_MDY_Export".strip().rstrip("\\/")
CSV_PATH = os.path.join(OUT_DIR, "brace.csv")
FT_TO_M  = 0.3048


def story_index(name):
    if not name: return 10_000
    m = re.search(r'(\d+)', name)
    if not m: return 10_000
    n = int(m.group(1))
    if 1 <= n <= 32: return n
    return 9_000 + n

def get_type_and_family_strings(e):
    tname = ""; fname = ""
    try:
        sym = doc.GetElement(e.GetTypeId())
        if sym:
            p = sym.get_Parameter(BuiltInParameter.SYMBOL_NAME_PARAM)
            if p: tname = p.AsString() or ""
            fam = getattr(sym, "Family", None)
            if fam and fam.Name: fname = fam.Name
    except: pass
    return tname, fname

def section_name(e):
    t, _ = get_type_and_family_strings(e)
    return t or (e.Name if hasattr(e, "Name") else "UNKNOWN")

def is_hs_or_hss_square(name_or_family):
    s = (name_or_family or "").upper().replace(" ", "").replace("×", "X")
    if ("HS" not in s) and ("HSS" not in s): return False
    m = re.search(r'(?:HSS|HS)[^0-9]*([0-9]+(?:\.[0-9]+)?)X([0-9]+(?:\.[0-9]+)?)', s)
    if not m: return False
    a = float(m.group(1)); b = float(m.group(2))
    if a <= 0 or b <= 0: return False
    return abs(a - b) / max(a, b) <= 0.05  

def get_line(e):
    try:
        loc = e.Location
        if hasattr(loc, "Curve"):
            crv = loc.Curve
            if isinstance(crv, Line):
                return crv
    except: pass
    return None

def real_length_m(e):
    try:
        p = e.get_Parameter(BuiltInParameter.CURVE_ELEM_LENGTH)
        if p:
            Lft = p.AsDouble()
            if Lft and Lft > 0: return Lft * FT_TO_M
    except: pass
    ln = get_line(e)
    return ln.Length * FT_TO_M if ln else 0.0

def brace_direction_from_self(line_dir):
    # Classification using plane principal axis
    dx, dy = abs(line_dir.X), abs(line_dir.Y)
    # For inclined parts close to 45°, the ratio of the main axis is used to determine the angle; geometrically, they will still fall into one of two categories
    return "west-east" if dx >= dy else "south-north"

def safe_write_csv(path, header, rows):
    if not os.path.isdir(OUT_DIR): os.makedirs(OUT_DIR)
    def _open(p): return open(p, "w", newline="", encoding="utf-8")
    try:
        f = _open(path)
    except PermissionError:
        stamp = _dt.datetime.now().strftime("%Y%m%d_%H%M%S")
        base, ext = os.path.splitext(path)
        f = _open(base + "_" + stamp + ext)
    with f:
        w = csv.writer(f); w.writerow(header); w.writerows(rows)
    return path


levels = list(FilteredElementCollector(doc).OfClass(Level))
level_name_by_id = {lv.Id.IntegerValue: lv.Name for lv in levels}

all_fr = list(FilteredElementCollector(doc)
              .OfCategory(BuiltInCategory.OST_StructuralFraming)
              .WhereElementIsNotElementType())

# Filter braces & aggregate
groups = {}  

for e in all_fr:
    line = get_line(e)
    if not line: continue

    tname, fname = get_type_and_family_strings(e)
    if not (is_hs_or_hss_square(tname) or is_hs_or_hss_square(fname)):
        continue  

    sec = section_name(e)
    Lm  = real_length_m(e)
    if Lm <= 1e-6: continue

    # story
    story = None
    try:
        p = e.get_Parameter(BuiltInParameter.INSTANCE_REFERENCE_LEVEL_PARAM)
        if p:
            lid = p.AsElementId()
            if lid: story = level_name_by_id.get(lid.IntegerValue, None)
    except: pass
    if not story: story = "UNKNOWN"

    # Use the main axis of the brace itself
    dlab = brace_direction_from_self(line.Direction)

    groups.setdefault((story, sec, dlab), []).append(Lm)

#  sort -
items = []
for (story, sec, dlab), lens in groups.items():
    if not lens: continue
    items.append((story_index(story), story, sec, dlab,
                  round(min(lens), 3), round(max(lens), 3)))
items.sort(key=lambda t: (t[0], t[1], t[2], t[3]))

rows = [[story, sec, dlab, mn, mx] for (_i, story, sec, dlab, mn, mx) in items]


header = ["story", "section", "direction", "min_length", "max_length"]
csv_path = safe_write_csv(CSV_PATH, header, rows)

OUT = {"csv": csv_path, "preview": [header] + rows[:12]}
# ----------------------------------------
