# Dynamo graph Ceiling Beam Export.dyn (Dynamo 2.19.3.6394)

python_script = Python()  # CPython3; unwired: IN[0]
# ---------- python_script.python (293 lines) ----------
# -*- coding: utf-8 -*-
# Dynamo CPython3 for Revit 2024+
# Ceiling W-section beams -> REGULAR vs BRACED CSVs
# BRACED rows include an extra 'direction' column: 'south-north' (Y-like) or 'west-east' (X-like)

import clr, sys, os, re, math, csv, datetime as _dt
clr.AddReference('RevitAPI'); clr.AddReference('RevitServices')
from Autodesk.Revit.DB import (
    FilteredElementCollector, BuiltInCategory, BuiltInParameter,
    Level, Line, XYZ
)
from RevitServices.Persistence import DocumentManager
doc = DocumentManager.Instance.CurrentDBDocument


OUT_DIR = r"C:\Users\Levi\Desktop\Final_MDY_Export".strip().rstrip("\\/")
REGULAR_CSV = os.path.join(OUT_DIR, "ceiling_beam_regular.csv")
BRACED_CSV  = os.path.join(OUT_DIR, "ceiling_beam_braced.csv")

FT_TO_M = 0.3048
M_TO_FT = 1.0 / FT_TO_M

# thresholds 
ANG_BEAM_TOL_DEG = 7.5      
ANGLE_MIN = 5.0              
ANGLE_MAX = 85.0             
PLAN_ATTACH_TOL_M = 0.15     
PLAN_ATTACH_TOL_FT = PLAN_ATTACH_TOL_M * M_TO_FT
Z_END_TOL_M = 0.6            
Z_END_TOL_FT = Z_END_TOL_M * M_TO_FT


def is_ceiling_level_name(name):
    return "ceiling" in (name or "").lower()

def story_index(name):
    if not name: return 10_000
    m = re.search(r'(\d+)', name)
    if not m: return 10_000
    n = int(m.group(1))
    if 1 <= n <= 32: return n
    return 9_000 + n

def angle_to_x(vec):
    
    return math.degrees(math.atan2(abs(vec.Y), abs(vec.X)))

def is_x_like(vec): return angle_to_x(vec) <= ANG_BEAM_TOL_DEG
def is_y_like(vec): return angle_to_x(vec) >= (90.0 - ANG_BEAM_TOL_DEG)

def direction_label(vec):
    return "west-east" if is_x_like(vec) else ("south-north" if is_y_like(vec) else "other")

def norm2(v): return math.sqrt(v.X*v.X + v.Y*v.Y + v.Z*v.Z)

def angle_between(u, v):
    nu = norm2(u); nv = norm2(v)
    if nu < 1e-9 or nv < 1e-9: return None
    dot = (u.X*v.X + u.Y*v.Y + u.Z*v.Z) / (nu*nv)
    dot = max(-1.0, min(1.0, dot))
    return math.degrees(math.acos(dot))

def proj_XZ(v): return XYZ(v.X, 0.0, v.Z)
def proj_YZ(v): return XYZ(0.0, v.Y, v.Z)

def get_type_and_family_strings(elem):
    tname = ""; fname = ""
    try:
        sym = doc.GetElement(elem.GetTypeId())
        if sym:
            p = sym.get_Parameter(BuiltInParameter.SYMBOL_NAME_PARAM)
            if p: tname = p.AsString() or ""
            fam = getattr(sym, "Family", None)
            if fam and fam.Name: fname = fam.Name
    except: pass
    return tname, fname

def get_section_string(elem):
    tname, _ = get_type_and_family_strings(elem)
    return tname or (elem.Name if hasattr(elem, "Name") else "UNKNOWN")

def is_w_section(section_name):
    if not section_name: return False
    s = section_name.strip().upper().replace(" ", "").replace("×", "X")
    return bool(re.match(r"^W\d", s))

def is_hs_or_hss_square(type_or_family):
    s = (type_or_family or "").upper().replace(" ", "").replace("×", "X")
    if ("HS" not in s) and ("HSS" not in s):
        return False
    m = re.search(r'(?:HSS|HS)[^0-9]*([0-9]+(?:\.[0-9]+)?)X([0-9]+(?:\.[0-9]+)?)', s)
    if not m: return False
    a = float(m.group(1)); b = float(m.group(2))
    if a <= 0 or b <= 0: return False
    return abs(a - b) / max(a, b) <= 0.05  

def get_elem_line(elem):
    try:
        loc = elem.Location
        if hasattr(loc, "Curve"):
            crv = loc.Curve
            if isinstance(crv, Line):
                return crv
    except: pass
    return None

def get_beam_length_m(elem):
    try:
        p = elem.get_Parameter(BuiltInParameter.CURVE_ELEM_LENGTH)
        if p:
            Lft = p.AsDouble()
            if Lft and Lft > 0: return Lft * FT_TO_M
    except: pass
    crv = get_elem_line(elem)
    return crv.Length * FT_TO_M if crv else 0.0

def p2d(xyz): return (xyz.X, xyz.Y)

def segs_intersect_2d(a1, a2, b1, b2):
    def orient(p, q, r): return (q[0]-p[0])*(r[1]-p[1]) - (q[1]-p[1])*(r[0]-p[0])
    def onseg(p, q, r):
        return (min(p[0], r[0])-1e-9 <= q[0] <= max(p[0], r[0])+1e-9 and
                min(p[1], r[1])-1e-9 <= q[1] <= max(p[1], r[1])+1e-9)
    o1 = orient(a1,a2,b1); o2 = orient(a1,a2,b2)
    o3 = orient(b1,b2,a1); o4 = orient(b1,b2,a2)
    if (o1*o2 < 0) and (o3*o4 < 0): return True
    if abs(o1)<1e-9 and onseg(a1,b1,a2): return True
    if abs(o2)<1e-9 and onseg(a1,b2,a2): return True
    if abs(o3)<1e-9 and onseg(b1,a1,b2): return True
    if abs(o4)<1e-9 and onseg(b1,a2,b2): return True
    return False

def dist_point_to_seg_2d(pt, a, b):
    px, py = pt; ax, ay = a; bx, by = b
    vx, vy = bx-ax, by-ay; wx, wy = px-ax, py-ay
    c1 = vx*wx + vy*wy
    if c1 <= 0: return math.hypot(wx, wy)
    c2 = vx*vx + vy*vy
    if c2 <= 1e-12: return math.hypot(wx, wy)
    t = c1 / c2
    if t >= 1.0: return math.hypot(px-bx, py-by)
    projx, projy = ax + t*vx, ay + t*vy
    return math.hypot(px-projx, py-projy)

def seg_min_dist_2d(a1, a2, b1, b2):
    if segs_intersect_2d(a1,a2,b1,b2): return 0.0
    return min(
        dist_point_to_seg_2d(a1, b1, b2),
        dist_point_to_seg_2d(a2, b1, b2),
        dist_point_to_seg_2d(b1, a1, a2),
        dist_point_to_seg_2d(b2, a1, a2),
    )

def plan_touch(beam_line, other_line):
    b1 = p2d(beam_line.GetEndPoint(0)); b2 = p2d(beam_line.GetEndPoint(1))
    s  = p2d(other_line.GetEndPoint(0)); e  = p2d(other_line.GetEndPoint(1))
    return seg_min_dist_2d(b1,b2,s,e) <= PLAN_ATTACH_TOL_FT

def endpoint_z_matches(beam_line, other_line):
    bz = 0.5 * (beam_line.GetEndPoint(0).Z + beam_line.GetEndPoint(1).Z)
    return (abs(other_line.GetEndPoint(0).Z - bz) <= Z_END_TOL_FT or
            abs(other_line.GetEndPoint(1).Z - bz) <= Z_END_TOL_FT)

def angle_in_vertical_plane_ok(beam_dir, brace_dir):
    if is_x_like(beam_dir):
        u = proj_XZ(brace_dir); v = XYZ(1,0,0)  
    elif is_y_like(beam_dir):
        u = proj_YZ(brace_dir); v = XYZ(0,1,0)  
    else:
        u = proj_YZ(brace_dir); v = XYZ(0,1,0)
    ang = angle_between(u, v)
    return (ang is not None) and (ANGLE_MIN <= ang <= ANGLE_MAX)

def safe_write_csv(path, header, rows):
    if not os.path.isdir(OUT_DIR): os.makedirs(OUT_DIR)
    def _open(p): return open(p, "w", newline="", encoding="utf-8")
    try:
        f = _open(path)
    except PermissionError:
        stamp = _dt.datetime.now().strftime("%Y%m%d_%H%M%S")
        base, ext = os.path.splitext(path)
        path = base + "_" + stamp + ext
        f = _open(path)
    with f:
        w = csv.writer(f); w.writerow(header)
        for r in rows: w.writerow(r)
    return path

# Collect levels 
levels = [lv for lv in FilteredElementCollector(doc).OfClass(Level) if is_ceiling_level_name(lv.Name)]
ceiling_ids = set(lv.Id.IntegerValue for lv in levels)
level_name_by_id = {lv.Id.IntegerValue: lv.Name for lv in levels}

# Collect all Structural Framing 
all_fr = list(FilteredElementCollector(doc)
              .OfCategory(BuiltInCategory.OST_StructuralFraming)
              .WhereElementIsNotElementType())

#  HS/HSS-square brace pool
brace_pool = [] 
for e in all_fr:
    line = get_elem_line(e)
    if not line: continue
    tname, fname = get_type_and_family_strings(e)
    if not (is_hs_or_hss_square(tname) or is_hs_or_hss_square(fname)):
        continue
    brace_pool.append({"line": line, "dir": line.Direction})

#  Iterate W-beams on ceiling levels 
regular = {}                    
braced  = {}                     

for e in all_fr:
    # Level filter: ceiling only
    try:
        p = e.get_Parameter(BuiltInParameter.INSTANCE_REFERENCE_LEVEL_PARAM)
        if not p: continue
        lid = p.AsElementId()
        if not lid or lid.IntegerValue not in ceiling_ids: continue
        story = level_name_by_id.get(lid.IntegerValue, None)
        if not story: continue
    except:
        continue

    line = get_elem_line(e)
    if not line: continue

    bdir = line.Direction
    if not (is_x_like(bdir) or is_y_like(bdir)):
        continue  

    # W-section only
    section = get_section_string(e)
    if not is_w_section(section):
        continue

    # real length
    Lm = get_beam_length_m(e)
    if Lm <= 1e-6: continue

    # brace detection
    is_br = False
    for br in brace_pool:
        if not plan_touch(line, br["line"]):
            continue
        if not endpoint_z_matches(line, br["line"]):
            continue
        if not angle_in_vertical_plane_ok(bdir, br["dir"]):
            continue
        is_br = True
        break

    if is_br:
        dlab = direction_label(bdir)  # 'west-east' or 'south-north'
        key = (story, section, dlab)
        braced.setdefault(key, []).append(Lm)
    else:
        key = (story, section)
        regular.setdefault(key, []).append(Lm)

#  Reduce & sort 
def rows_regular_sorted(groups):
    items = []
    for (story, section), lens in groups.items():
        if not lens: continue
        items.append((story_index(story), story, section,
                      round(min(lens),3), round(max(lens),3)))
    items.sort(key=lambda t: (t[0], t[1], t[2]))
    return [[story, section, mn, mx] for (_i, story, section, mn, mx) in items]

def rows_braced_sorted(groups):
    items = []
    for (story, section, dirlab), lens in groups.items():
        if not lens: continue
        items.append((story_index(story), story, section, dirlab,
                      round(min(lens),3), round(max(lens),3)))
    items.sort(key=lambda t: (t[0], t[1], t[2], t[3]))
    return [[story, section, dirlab, mn, mx] for (_i, story, section, dirlab, mn, mx) in items]

rows_reg = rows_regular_sorted(regular)
rows_bra = rows_braced_sorted(braced)


path_reg = safe_write_csv(REGULAR_CSV, ["story","section","min_length","max_length"], rows_reg)
path_bra = safe_write_csv(BRACED_CSV,  ["story","section","direction","min_length","max_length"], rows_bra)


OUT = {
    "regular_csv": path_reg,
    "braced_csv":  path_bra,
    "regular_preview": [["story","section","min_length","max_length"]] + rows_reg[:10],
    "braced_preview":  [["story","section","direction","min_length","max_length"]] + rows_bra[:10]
}
# ----------------------------------------
