# Dynamo graph Column Export.dyn (Dynamo 2.19.3.6394)

python_script = Python()  # CPython3; unwired: IN[0]
# ---------- python_script.python (314 lines) ----------
# -*- coding: utf-8 -*-
# Revit 2024 + Dynamo CPython3
# Column.csv: per-module brace edges -> column counts exactly on boundary ends (HSS square braces only)

import clr, os, re, math, json, csv, datetime as _dt
clr.AddReference('RevitAPI'); clr.AddReference('RevitServices')
from Autodesk.Revit.DB import *
from RevitServices.Persistence import DocumentManager

doc   = DocumentManager.Instance.CurrentDBDocument
uidoc = DocumentManager.Instance.CurrentUIApplication.ActiveUIDocument


OUT_DIR  = r"C:\Users\Levi\Desktop\Final_MDY_Export".strip().rstrip("\\/")
CSV_PATH = os.path.join(OUT_DIR, "Column.csv")

AREA_SCHEME_NAME = None        # None = use the currently active Area view's Scheme; or set to "Rentable"
ORDER_SERPENTINE = False       #False = every column goes south->north; True = snake-like (even columns go south->north, odd columns go north->south)


INSIDE_TOL_M   = 0.005         # Bounding tolerance of a point within a rectangle
EDGE_TOL_M     = 0.20          # Bracing end edge tolerance
ON_BOUND_TOL_M = 0.08          # Horizontal distance tolerance for “column on edge” judgment 
END_WINDOW_M   = 1.05          # The length of the counting window from both ends of the edge


FT_TO_M = 0.3048
M_TO_FT = 1.0 / FT_TO_M

INSIDE_TOL_FT  = INSIDE_TOL_M * M_TO_FT
EDGE_TOL_FT    = EDGE_TOL_M   * M_TO_FT
ON_BOUND_TOL_FT= ON_BOUND_TOL_M*M_TO_FT
END_WINDOW_FT  = END_WINDOW_M * M_TO_FT


def safe_open_csv(path):
    if not os.path.isdir(OUT_DIR):
        os.makedirs(OUT_DIR)
    try:
        return open(path, "w", newline="", encoding="utf-8-sig")
    except PermissionError:
        base, ext = os.path.splitext(path)
        p = base + "_" + _dt.datetime.now().strftime("%Y%m%d_%H%M%S") + ext
        return open(p, "w", newline="", encoding="utf-8-sig")

def get_target_scheme():
    if AREA_SCHEME_NAME:
        for s in FilteredElementCollector(doc).OfClass(AreaScheme):
            if s.Name == AREA_SCHEME_NAME:
                return s
        raise Exception("Area Scheme '{}' not found".format(AREA_SCHEME_NAME))
    av = uidoc.ActiveView
    if isinstance(av, ViewPlan) and av.ViewType == ViewType.AreaPlan:
        return av.AreaScheme
    raise Exception("Activate an Area Plan view, or set AREA_SCHEME_NAME.")

def all_area_plans_in_scheme(scheme):
    vs = [v for v in FilteredElementCollector(doc).OfClass(ViewPlan)
          if v.ViewType==ViewType.AreaPlan and v.AreaScheme and v.AreaScheme.Id==scheme.Id]
    vs.sort(key=lambda v: v.GenLevel.Elevation if v.GenLevel else 0.0)
    return vs

def area_outer_bbox(area):
    opt = SpatialElementBoundaryOptions()
    loops = area.GetBoundarySegments(opt)
    xs=[]; ys=[]
    for segList in loops:
        for seg in segList:
            c = seg.GetCurve()
            p0=c.GetEndPoint(0); p1=c.GetEndPoint(1)
            xs += [p0.X, p1.X]; ys += [p0.Y, p1.Y]
    if not xs or not ys: return None
    return (min(xs), max(xs), min(ys), max(ys))

def seg_dist_param(pt, a, b):
    vx=b.X-a.X; vy=b.Y-a.Y
    wx=pt.X-a.X; wy=pt.Y-a.Y
    L2=vx*vx+vy*vy
    if L2<=1e-12: return 0.0, math.hypot(pt.X-a.X, pt.Y-a.Y)
    t=max(0.0, min(1.0, (wx*vx+wy*vy)/L2))
    proj=XYZ(a.X+vx*t, a.Y+vy*t, pt.Z)
    d=math.hypot(pt.X-proj.X, pt.Y-proj.Y)
    return t, d

def columns_on_level(level):
    cols = FilteredElementCollector(doc)\
        .OfCategory(BuiltInCategory.OST_StructuralColumns)\
        .WhereElementIsNotElementType().ToElements()
    out=[]
    for c in cols:
        try:
            if c.LevelId.IntegerValue != level.Id.IntegerValue: continue
            loc=c.Location
            if isinstance(loc, LocationPoint): p=loc.Point
            elif isinstance(loc, LocationCurve): p=loc.Curve.Evaluate(0.5, True)
            else: 
                bb=c.get_BoundingBox(None); p=(bb.Min+bb.Max)/2.0
            out.append((c, XYZ(p.X,p.Y,level.Elevation)))
        except: pass
    return out

def most_common_column_type(level_cols):
    cnt={}
    for c,_ in level_cols:
        try:
            t=doc.GetElement(c.GetTypeId())
            nm = (t.LookupParameter("Type Name").AsString()
                  if t.LookupParameter("Type Name")
                  else t.get_Parameter(BuiltInParameter.SYMBOL_NAME_PARAM).AsString())
            cnt[nm]=cnt.get(nm,0)+1
        except: pass
    if not cnt: return ""
    return max(cnt.items(), key=lambda kv: kv[1])[0]

#HSS/HS square brace filtering 
def get_type_and_family_strings(e):
    tname=fname=""
    try:
        sym=doc.GetElement(e.GetTypeId())
        if sym:
            p=sym.get_Parameter(BuiltInParameter.SYMBOL_NAME_PARAM)
            if p: tname=p.AsString() or ""
            fam=getattr(sym,"Family",None)
            if fam and fam.Name: fname=fam.Name
    except: pass
    return tname, fname

def is_hs_or_hss_square(s):
    s=(s or "").upper().replace(" ","").replace("×","X")
    if ("HS" not in s) and ("HSS" not in s): return False
    m=re.search(r'(?:HSS|HS)[^0-9]*([0-9]+(?:\.[0-9]+)?)X([0-9]+(?:\.[0-9]+)?)', s)
    if not m: return False
    a=float(m.group(1)); b=float(m.group(2))
    return a>0 and b>0 and abs(a-b)/max(a,b) <= 0.05

def braces_on_level_hss_square(level):
    fams = FilteredElementCollector(doc)\
        .OfCategory(BuiltInCategory.OST_StructuralFraming)\
        .WhereElementIsNotElementType().ToElements()
    out=[]
    lvl_id=level.Id.IntegerValue
    for f in fams:
        try:
            tname,fname = get_type_and_family_strings(f)
            if not (is_hs_or_hss_square(tname) or is_hs_or_hss_square(fname)):
                continue
            loc = getattr(f,"Location",None)
            if not isinstance(loc, LocationCurve): 
                continue
            ref = f.get_Parameter(BuiltInParameter.INSTANCE_REFERENCE_LEVEL_PARAM)
            if not ref: 
                continue
            rid = ref.AsElementId()
            if not rid or rid.IntegerValue != lvl_id:
                continue
            c  = loc.Curve
            p0 = c.GetEndPoint(0); p1 = c.GetEndPoint(1)
            z  = level.Elevation
            out.append((XYZ(p0.X,p0.Y,z), XYZ(p1.X,p1.Y,z)))
        except: pass
    return out

# Determine "which diagonal braces fall on a certain edge in the module rectangle"
def braces_on_edges_in_rect(x0,x1,y0,y1, brace_pts):
    z = 0.0
    westA, westB   = XYZ(x0,y0,z), XYZ(x0,y1,z)  # 南->北
    eastA, eastB   = XYZ(x1,y0,z), XYZ(x1,y1,z)
    southA, southB = XYZ(x0,y0,z), XYZ(x1,y0,z)  # 西->东
    northA, northB = XYZ(x0,y1,z), XYZ(x1,y1,z)

    def map_to_edge(pt):
        tW,dW = seg_dist_param(pt, westA,  westB)
        tE,dE = seg_dist_param(pt, eastA,  eastB)
        tS,dS = seg_dist_param(pt, southA, southB)
        tN,dN = seg_dist_param(pt, northA, northB)
        dmin=min(dW,dE,dS,dN)
        if dmin==dW: return ("west",  tW, dW)
        if dmin==dE: return ("east",  tE, dE)
        if dmin==dS: return ("south", tS, dS)
        return ("north", tN, dN)

    braces=[]
    for (p0,p1) in brace_pts:
        if not ((x0-INSIDE_TOL_FT<=p0.X<=x1+INSIDE_TOL_FT and y0-INSIDE_TOL_FT<=p0.Y<=y1+INSIDE_TOL_FT) and
                (x0-INSIDE_TOL_FT<=p1.X<=x1+INSIDE_TOL_FT and y0-INSIDE_TOL_FT<=p1.Y<=y1+INSIDE_TOL_FT)):
            continue
        (e0,t0,d0) = map_to_edge(p0)
        (e1,t1,d1) = map_to_edge(p1)
        if e0==e1 and max(d0,d1) <= EDGE_TOL_FT:
            s_t, e_t = (t0,t1) if t0<=t1 else (t1,t0)
            braces.append((e0, s_t, e_t))
    return braces

# Module sorting: West->East in columns; South->North in columns
def cluster(vals, tol_ft):
    vals = sorted(vals)
    bins=[]
    for v in vals:
        if not bins or abs(v - bins[-1][-1]) > tol_ft:
            bins.append([v])
        else:
            bins[-1].append(v)
    return [sum(b)/len(b) for b in bins]

def order_modules(rects, serpentine=False):
    col_keys = cluster([r["x0"] for r in rects], tol_ft=0.20*M_TO_FT)  
    for r in rects:
        r["col"] = min(range(len(col_keys)), key=lambda i: abs(r["x0"]-col_keys[i]))
    columns=[]
    for ci in sorted(set(r["col"] for r in rects)):
        col = sorted([r for r in rects if r["col"]==ci], key=lambda r:r["y0"]) 
        if serpentine and (ci % 2 == 1):
            col = list(reversed(col))  
        columns.append(col)
    ordered=[]; mid=0
    for col in columns:
        for r in col:
            mid+=1; r["id"]=mid; ordered.append(r)
    return ordered

# Only count the columns that are on the edge and close to the endpoint
def count_on_edge_ends(A, B, level_cols):
    """
    A, B: Edge endpoints (feet). South->North for vertical edges; West->East for horizontal edges.
    Rules:
    1) If the minimum distance from a point to a line segment is <= ON_BOUND_TOL_FT, the point is considered "on that edge."
    2) Calculate the arc length s (feet) along the edge. If s <= END_WINDOW_FT, calculate the arc length.
    If (L - s) <= END_WINDOW_FT, calculate the arc length.
    Return: (start_count, end_count)
    """
    Lft = math.hypot(B.X - A.X, B.Y - A.Y)
    if Lft <= 1e-9:
        return (0, 0)

    start_n = 0
    end_n   = 0

    for _c, p in level_cols:
        t, d = seg_dist_param(p, A, B)   # d: feet; t: 0..1
        if d <= ON_BOUND_TOL_FT and -1e-6 <= t <= 1+1e-6:
            s = t * Lft
            if s <= END_WINDOW_FT:
                start_n += 1
            elif (Lft - s) <= END_WINDOW_FT:
                end_n += 1

    return (start_n, end_n)


scheme = get_target_scheme()
views  = all_area_plans_in_scheme(scheme)
rows   = []

for v in views:
    areas = [a for a in FilteredElementCollector(doc, v.Id)
             .OfClass(SpatialElement) if isinstance(a, Area)]
    rects=[]
    for a in areas:
        bbox = area_outer_bbox(a)
        if not bbox: continue
        x0,x1,y0,y1 = bbox
        rects.append({"x0":x0,"x1":x1,"y0":y0,"y1":y1})
    if not rects: 
        continue

    ordered = order_modules(rects, serpentine=ORDER_SERPENTINE)
    lvl_cols = columns_on_level(v.GenLevel)
    section  = most_common_column_type(lvl_cols)
    lvl_brs  = braces_on_level_hss_square(v.GenLevel)

    for r in ordered:
        x0,x1,y0,y1 = r["x0"], r["x1"], r["y0"], r["y1"]

        brs = braces_on_edges_in_rect(x0,x1,y0,y1, lvl_brs)
        if not brs:
            continue  

        
        z = v.GenLevel.Elevation
        westA, westB   = XYZ(x0,y0,z), XYZ(x0,y1,z)  #
        eastA, eastB   = XYZ(x1,y0,z), XYZ(x1,y1,z)
        southA, southB = XYZ(x0,y0,z), XYZ(x1,y0,z)  #
        northA, northB = XYZ(x0,y1,z), XYZ(x1,y1,z)

        edges_present = {edge for (edge, _ts, _te) in brs}
        j = {}

        if "west" in edges_present:
            s,e = count_on_edge_ends(westA, westB, lvl_cols)
            if s or e:
                j["west-start"] = s; j["west-end"] = e
        if "east" in edges_present:
            s,e = count_on_edge_ends(eastA, eastB, lvl_cols)
            if s or e:
                j["east-start"] = s; j["east-end"] = e
        if "south" in edges_present:
            s,e = count_on_edge_ends(southA, southB, lvl_cols)
            if s or e:
                j["south-start"] = s; j["south-end"] = e
        if "north" in edges_present:
            s,e = count_on_edge_ends(northA, northB, lvl_cols)
            if s or e:
                j["north-start"] = s; j["north-end"] = e

        rows.append([v.GenLevel.Name, section, "M{}".format(r["id"]),
                     json.dumps(j, separators=(',',':'))])

# 
with safe_open_csv(CSV_PATH) as f:
    w = csv.writer(f)
    w.writerow(["level","section","module","json"])
    w.writerows(rows)

OUT = "Done: wrote {} rows → {}".format(len(rows), CSV_PATH)
# ----------------------------------------
