# Dynamo graph Height Export.dyn (Dynamo 2.19.3.6394)

categories = Categories("OST_Levels")
all_elements_of_category = ElementsOfCategory(Category=categories)
python_script = Python(IN[0]=all_elements_of_category)  # CPython3
# ---------- python_script.python (119 lines) ----------
# Dynamo Python Script - Export Level heights to CSV (meters)
# module = same-story thickness = (Ceiling - Floor)
# vertical_con = nextFloor - thisCeiling (top story -> 0.0)

import clr, re, os

# Revit plumbing
clr.AddReference('RevitAPI')
clr.AddReference('RevitServices')
from Autodesk.Revit.DB import FilteredElementCollector, Level
from RevitServices.Persistence import DocumentManager

# .NET IO
from System.IO import Directory, StreamWriter, Path
from System.Text import UTF8Encoding

doc = DocumentManager.Instance.CurrentDBDocument

# ---------- Config ----------
EXPORT_DIR  = r"C:\Users\Levi\Desktop\Final_MDY_Export"
EXPORT_FILE = "height.csv"
EXPORT_PATH = Path.Combine(EXPORT_DIR, EXPORT_FILE)

FT_TO_M = 0.3048  # feet → meters

def natural_key(s):
    """Ensure 'Level 10' sorts after 'Level 9'."""
    return [int(t) if t.isdigit() else t.lower() for t in re.split(r'(\d+)', s or "")]

def match_ceiling(floor_name, floor_elev, ceil_dict, ceilings):
    """1) exact '<FloorName> Ceiling'  2) nearest ceiling strictly above."""
    target = floor_name + " Ceiling"
    if target in ceil_dict:
        return target, ceil_dict[target]
    above = [(n, e) for (n, e) in ceilings if e > floor_elev]
    if above:
        n, e = min(above, key=lambda t: t[1] - floor_elev)
        return n, e
    return None, None

def csv_line(row):
    """Minimal CSV quoting."""
    parts = []
    for v in row:
        s = "" if v is None else str(v)
        if any(ch in s for ch in [",", '"', "\n", "\r"]):
            s = '"' + s.replace('"', '""') + '"'
        parts.append(s)
    return ",".join(parts)

# ---------- Collect and sort levels ----------
levels = list(FilteredElementCollector(doc).OfClass(Level))

pairs  = []      # [(name, elev_m)]
ground = None
for lv in levels:
    name   = lv.Name
    elev_m = float(lv.Elevation) * FT_TO_M
    pairs.append((name, elev_m))
    if "ground" in (name or "").lower():
        ground = ("ground_level", elev_m)

pairs.sort(key=lambda t: (t[1], natural_key(t[0])))

# Split floors vs ceilings
floors   = [(n, e) for (n, e) in pairs if "ceiling" not in (n or "").lower() and "ground" not in (n or "").lower()]
ceilings = [(n, e) for (n, e) in pairs if "ceiling" in  (n or "").lower()]
ceil_dict = {n: e for (n, e) in ceilings}

# ---------- Compute per story ----------
rows = []
for i, (fname, f_e) in enumerate(floors):
    cname, c_e = match_ceiling(fname, f_e, ceil_dict, ceilings)

    if c_e is None:
        # Missing ceiling → module (thickness) unknown
        vcon = None
        module = None
        c_e_out = None
    else:
        # Same-story thickness (this is the desired "module")
        module = c_e - f_e                       # ← FIXED: module = Ceiling - Floor
        # vertical connector to next story
        if i < len(floors) - 1:
            next_floor_e = floors[i + 1][1]
            vcon = next_floor_e - c_e
            if vcon < -1e-6:
                vcon = None
        else:
            vcon = 0.0                           # top story convention
        c_e_out = round(c_e, 6)

    rows.append([
        fname,
        round(f_e, 6),                            # Floor Elev (m)
        cname or "",                              # Ceiling Level
        c_e_out,                                  # Ceiling Elev (m)
        None if vcon   is None else round(vcon, 6),   # vertical_con (m)
        None if module is None else round(module, 6)  # module (m) = thickness
    ])

# ---------- Build table ----------
headers = ["Level", "Floor Elev (m)", "Ceiling Level", "Ceiling Elev (m)", "vertical_con (m)", "module (m)"]
table = []
table.append(["ground_level (m)", None if ground is None else round(ground[1], 6)])
table.append(headers)
table.extend(rows)

# ---------- Write CSV (UTF-8 BOM for Excel) ----------
Directory.CreateDirectory(EXPORT_DIR)
utf8_bom = UTF8Encoding(True)
sw = StreamWriter(EXPORT_PATH, False, utf8_bom)
try:
    for r in table:
        sw.WriteLine(csv_line(r))
finally:
    sw.Close()

OUT = EXPORT_PATH
# ----------------------------------------
