# Dynamo graph Layout Export.dyn (Dynamo 2.19.3.6394)

python_script = Python()  # CPython3; unwired: IN[0]
# ---------- python_script.python (311 lines) ----------
# -*- coding: utf-8 -*-
# Revit 2024+ / Dynamo CPython3
# Area-based ModularPy layout extractor (ONE CSV)
# - Orders modules column-wise (west->east), each column bottom->top
# - Location strings per your spec: south-west / east-{id} / north-{id}
# - we-dir = horizontal (E–W), sn-dir = vertical (N–S)
# - Braces: HS/HSS square only; per-side ranges; module type = Chevron / X (robust)
# - CSV first row is metadata: "gap_we (m),<value>"
# - Then header: module,we-dir,sn-dir,location,brace (brace is a JSON-like string)

import clr, os, re, math, csv, json, datetime as _dt
clr.AddReference('RevitAPI'); clr.AddReference('RevitServices')
from Autodesk.Revit.DB import (
    FilteredElementCollector, BuiltInCategory, BuiltInParameter,
    Level, Area, SpatialElementBoundaryOptions, Line, XYZ
)
from RevitServices.Persistence import DocumentManager
doc = DocumentManager.Instance.CurrentDBDocument


LEVEL_NAME     = "Level 1"   
OUT_DIR        = r"C:\Users\Levi\Desktop\Final_MDY_Export".strip().rstrip("\\/")
CSV_PATH       = os.path.join(OUT_DIR, "layout_all.csv")

# Tolerances (meters)
FT_TO_M = 0.3048; M_TO_FT = 1.0/FT_TO_M
ANG_MIN_X_DEG  = 20.0        
EDGE_MARGIN_M  = 0.20        
EDGE_NEAR_M    = 0.25        
MERGE_GAP_M    = 0.02        
ENTIRE_TOL_M   = 0.10       
COL_CLUSTER_M  = 0.20        
RANGE_ROUND    = 2


def ensure_path(path):
    if not os.path.isdir(OUT_DIR): os.makedirs(OUT_DIR)
    try:
        open(path,"w").close(); return path
    except PermissionError:
        base,ext=os.path.splitext(path)
        return base+"_"+_dt.datetime.now().strftime("%Y%m%d_%H%M%S")+ext

def is_hs_or_hss_square(s):
    s=(s or "").upper().replace(" ","").replace("×","X")
    if ("HS" not in s) and ("HSS" not in s): return False
    m=re.search(r'(?:HSS|HS)[^0-9]*([0-9]+(?:\.[0-9]+)?)X([0-9]+(?:\.[0-9]+)?)', s)
    if not m: return False
    a=float(m.group(1)); b=float(m.group(2))
    return a>0 and b>0 and abs(a-b)/max(a,b) <= 0.05

def get_type_family_name(e):
    tn=fn=""
    try:
        sym=doc.GetElement(e.GetTypeId())
        if sym:
            p=sym.get_Parameter(BuiltInParameter.SYMBOL_NAME_PARAM)
            if p: tn=p.AsString() or ""
            fam=getattr(sym,"Family",None)
            if fam and fam.Name: fn=fam.Name
    except: pass
    return tn, fn

def get_line(e):
    loc=getattr(e,"Location",None)
    if not loc or not hasattr(loc,"Curve"): return None
    crv=loc.Curve
    return crv if isinstance(crv,Line) else None

def p2d(P): return (P.X,P.Y)

def seg_min_dist_2d(a1,a2,b1,b2):
    def orient(p,q,r): return (q[0]-p[0])*(r[1]-p[1])-(q[1]-p[1])*(r[0]-p[0])
    def onseg(p,q,r):  return (min(p[0],r[0])-1e-9<=q[0]<=max(p[0],r[0])+1e-9 and
                                min(p[1],r[1])-1e-9<=q[1]<=max(p[1],r[1])+1e-9)
    o1=orient(a1,a2,b1); o2=orient(a1,a2,b2); o3=orient(b1,b2,a1); o4=orient(b1,b2,a2)
    if (o1*o2<0) and (o3*o4<0): return 0.0
    if abs(o1)<1e-9 and onseg(a1,b1,a2): return 0.0
    if abs(o2)<1e-9 and onseg(a1,b2,a2): return 0.0
    if abs(o3)<1e-9 and onseg(b1,a1,b2): return 0.0
    if abs(o4)<1e-9 and onseg(b1,a2,b2): return 0.0
    # Take the nearest point distance when they do not intersect
    def dpt(pt,a,b):
        px,py=pt; ax,ay=a; bx,by=b
        vx,vy=bx-ax,by-ay; wx,wy=px-ax,py-ay
        c1=vx*wx+vy*wy
        if c1<=0: return math.hypot(wx,wy)
        c2=vx*vx+vy*vy
        if c2<=1e-12: return math.hypot(wx,wy)
        t=c1/c2
        if t>=1.0: return math.hypot(px-bx,py-by)
        return math.hypot(px-(ax+t*vx), py-(ay+t*vy))
    return min(dpt(a1,b1,b2), dpt(a2,b1,b2), dpt(b1,a1,a2), dpt(b2,a1,a2))

def intersect_point(a1,a2,b1,b2):
    # Find the intersection point of line segments ,return None if they do not strictly intersect
    def det(a,b,c,d): return a*d-b*c
    xdiff=(a1[0]-a2[0], b1[0]-b2[0])
    ydiff=(a1[1]-a2[1], b1[1]-b2[1])
    div=det(*xdiff,*ydiff)
    if abs(div)<1e-12: return None
    d=(det(*a1,*a2), det(*b1,*b2))
    x=det(d[0],xdiff[0],d[1],xdiff[1])/div
    y=det(d[0],ydiff[0],d[1],ydiff[1])/div
    
    def onseg(p,q,r):
        return (min(p[0],r[0])-1e-9 <= q[0] <= max(p[0],r[0])+1e-9 and
                min(p[1],r[1])-1e-9 <= q[1] <= max(p[1],r[1])+1e-9)
    if onseg(a1,(x,y),a2) and onseg(b1,(x,y),b2):
        return (x,y)
    return None

def merge_ranges(ranges, gap=MERGE_GAP_M):
    if not ranges: return []
    rs=sorted(ranges, key=lambda t:t[0])
    out=[list(rs[0])]
    for s,e in rs[1:]:
        if s - out[-1][1] <= gap: out[-1][1] = max(out[-1][1], e)
        else: out.append([s,e])
    return out

def range_text(s,e,L):
    if e - s >= L - ENTIRE_TOL_M: return "entire"
    s_=round(s,RANGE_ROUND); e_=round(e,RANGE_ROUND)
    if s <= ENTIRE_TOL_M and e < L-ENTIRE_TOL_M: return "start-{}".format(e_)
    if s > ENTIRE_TOL_M and e >= L-ENTIRE_TOL_M: return "{}-end".format(s_)
    return "{}-{}".format(s_,e_)

def rect_edges(x0,x1,y0,y1):
    return {
        "west":  (XYZ(x0,y0,0), XYZ(x0,y1,0), True),
        "east":  (XYZ(x1,y0,0), XYZ(x1,y1,0), True),
        "south": (XYZ(x0,y0,0), XYZ(x1,y0,0), False),
        "north": (XYZ(x0,y1,0), XYZ(x1,y1,0), False),
    }

def project_on_edge(A,B,seg,vertical):
    a=p2d(A); b=p2d(B)
    s0=p2d(seg.GetEndPoint(0)); s1=p2d(seg.GetEndPoint(1))
    # Minimum distance (feet) from an edge to determine if it belongs to that edge
    if seg_min_dist_2d(a,b,s0,s1) > EDGE_NEAR_M*M_TO_FT: return None
    L = (abs(B.Y-A.Y) if vertical else abs(B.X-A.X)) * FT_TO_M
    if vertical:
        s = max(0.0, min(L, abs(seg.GetEndPoint(0).Y - A.Y)*FT_TO_M))
        e = max(0.0, min(L, abs(seg.GetEndPoint(1).Y - A.Y)*FT_TO_M))
    else:
        s = max(0.0, min(L, abs(seg.GetEndPoint(0).X - A.X)*FT_TO_M))
        e = max(0.0, min(L, abs(seg.GetEndPoint(1).X - A.X)*FT_TO_M))
    if e < s: s,e = e,s
    if e - s <= 1e-4: return None
    return (s,e,L)

def cluster(values, tol_m):
    vals=sorted(values)
    bins=[]
    tol_ft=tol_m*M_TO_FT
    for v in vals:
        if not bins or abs(v-bins[-1][-1])>tol_ft: bins.append([v])
        else: bins[-1].append(v)
    return [sum(b)/len(b) for b in bins]

# Level & Areas
lvl=None
for L in FilteredElementCollector(doc).OfClass(Level):
    if (L.Name or "").strip().lower()==LEVEL_NAME.strip().lower():
        lvl=L; break
if not lvl: raise Exception("Level '{}' not found".format(LEVEL_NAME))

areas=[a for a in FilteredElementCollector(doc)
       .OfCategory(BuiltInCategory.OST_Areas).WhereElementIsNotElementType()
       if isinstance(a,Area) and a.LevelId.IntegerValue==lvl.Id.IntegerValue]
if not areas: raise Exception("No Areas on {}".format(LEVEL_NAME))

# Get boundary
opts=SpatialElementBoundaryOptions()
mods=[]
for a in areas:
    loops=a.GetBoundarySegments(opts)
    if not loops: continue
    xs=[]; ys=[]
    for loop in loops:
        for seg in loop:
            crv=seg.GetCurve()
            p0=crv.GetEndPoint(0); p1=crv.GetEndPoint(1)
            xs += [p0.X,p1.X]; ys += [p0.Y,p1.Y]
    x0=min(xs); x1=max(xs); y0=min(ys); y1=max(ys)
    mods.append({"x0":x0,"x1":x1,"y0":y0,"y1":y1})

#  collect HSS 
all_fr=list(FilteredElementCollector(doc)
            .OfCategory(BuiltInCategory.OST_StructuralFraming)
            .WhereElementIsNotElementType())
brace_lines=[]
for e in all_fr:
    ln=get_line(e)
    if not ln: continue
    tn,fn=get_type_family_name(e)
    nm=(getattr(e,"Name","") or "")
    if is_hs_or_hss_square(nm) or is_hs_or_hss_square(tn) or is_hs_or_hss_square(fn):
        brace_lines.append(ln)

# sort in order 
# First cluster by the west edge
col_keys = cluster([m["x0"] for m in mods], COL_CLUSTER_M)
for m in mods:
    m["col"] = min(range(len(col_keys)), key=lambda i: abs(m["x0"]-col_keys[i]))

# Each column from bottom to top
columns=[]
for ci in sorted(set(m["col"] for m in mods)):
    col=sorted([m for m in mods if m["col"]==ci], key=lambda m:m["y0"])
    columns.append(col)

# Generate module order and position labels
ordered=[]; id_of_bottom_in_col=[]
module_id=0
for c_idx, col in enumerate(columns):
    for r_idx, m in enumerate(col):
        module_id += 1
        m["id"] = module_id
        if c_idx==0 and r_idx==0:
            loc="south-west"
        elif r_idx==0:
            # New column bottom: east-{previous column bottom module ID}
            loc="east-{}".format(id_of_bottom_in_col[-1])
        else:
            # In the same column upwards: north-{ID of the module directly below}
            loc="north-{}".format(col[r_idx-1]["id"])
        m["location"]=loc
        if r_idx==0 and len(id_of_bottom_in_col)==c_idx: id_of_bottom_in_col.append(m["id"])
        ordered.append(m)

# calculate gap_we 
gaps=[]
for c1,c2 in zip(columns[:-1], columns[1:]):
    x1=max(m["x1"] for m in c1); x2=min(m["x0"] for m in c2)
    gaps.append( (x2 - x1) * FT_TO_M )
gap_we = round(min(gaps),3) if gaps else 0.0

# Identify brace side/range/type
def inside_rect(x0,x1,y0,y1, P):
    x,y=P.X,P.Y
    return (x0-1e-6<=x<=x1+1e-6) and (y0-1e-6<=y<=y1+1e-6)

rows=[]
for m in ordered:
    x0,x1,y0,y1 = m["x0"],m["x1"],m["y0"],m["y1"]
    
    we = round((x1-x0)*FT_TO_M,3)   # horizontal E–W
    sn = round((y1-y0)*FT_TO_M,3)   # vertical   N–S

    
    in_mod=[]
    for ln in brace_lines:
        a=ln.GetEndPoint(0); b=ln.GetEndPoint(1)
        if inside_rect(x0,x1,y0,y1,a) or inside_rect(x0,x1,y0,y1,b):
            in_mod.append(ln)

    # First determine the type: there are two intersections inside the rectangle, the intersection point is > EDGE_MARGIN_M from the boundary and the angle is > ANG_MIN_X_DEG → X
    mtype="Chevron"
    for i in range(len(in_mod)):
        a1=p2d(in_mod[i].GetEndPoint(0)); a2=p2d(in_mod[i].GetEndPoint(1))
        va=XYZ(a2[0]-a1[0], a2[1]-a1[1], 0.0)
        for j in range(i+1,len(in_mod)):
            b1=p2d(in_mod[j].GetEndPoint(0)); b2=p2d(in_mod[j].GetEndPoint(1))
            vb=XYZ(b2[0]-b1[0], b2[1]-b1[1], 0.0)
            ip=intersect_point(a1,a2,b1,b2)
            if not ip: continue
            x,y=ip
            if not (x0+EDGE_MARGIN_M*M_TO_FT <= x <= x1-EDGE_MARGIN_M*M_TO_FT and
                    y0+EDGE_MARGIN_M*M_TO_FT <= y <= y1-EDGE_MARGIN_M*M_TO_FT):
                continue
            # 
            def ang(u,v):
                nu=math.hypot(u.X,u.Y); nv=math.hypot(v.X,v.Y)
                if nu<1e-9 or nv<1e-9: return 0.0
                dot=(u.X*v.X+u.Y*v.Y)/(nu*nv)
                dot=max(-1.0,min(1.0,dot))
                return math.degrees(math.acos(dot))
            if ang(va,vb) > ANG_MIN_X_DEG:
                mtype="X"; break
        if mtype=="X": break

    # 
    edges = rect_edges(x0,x1,y0,y1)
    brace_items=[]
    for side,(A,B,vertical) in edges.items():
        L = (abs(B.Y-A.Y) if vertical else abs(B.X-A.X)) * FT_TO_M
        ranges=[]
        for ln in in_mod:
            pr = project_on_edge(A,B,ln,vertical)
            if pr is None: continue
            s,e,_=pr
            ranges.append([s,e])
        for s,e in merge_ranges(ranges):
            brace_items.append({"side":side, "range":range_text(s,e,L), "type":mtype})

    rows.append([
        m["id"], we, sn, m["location"],
        json.dumps(brace_items, ensure_ascii=False, separators=(',',':'))
    ])


p = ensure_path(CSV_PATH)
with open(p,"w",newline="",encoding="utf-8") as f:
    w=csv.writer(f)
    w.writerow(["gap_we (m)", gap_we])                   
    w.writerow(["module","we-dir","sn-dir","location","brace"])
    w.writerows(rows)

OUT = {"csv": p, "modules": len(rows), "gap_we": gap_we}
# ----------------------------------------
